# Grasshopper definition fractal_tree_00.gh (Grasshopper 1.0.4)

length_randomness = Slider(36, range=0..100)
angle_randomness = Slider(46, range=0..100)
depth = Slider(15, range=1..15)
max_angle = Slider(27, range=5..90)
starting_length = Slider(334, range=50..1000)
length_change = Slider(0.7, range=-0.1..0.9)
construct_point = ConstructPoint(XCoordinate=0, YCoordinate=0, ZCoordinate=0)
unit_y = UnitY(Factor=1)
line_sdl = LineSDL(Start=construct_point, Direction=unit_y, Length=Slider(1, range=0..1))
ghpython_script = GhPythonScript(
    depth=depth,
    angle=max_angle,
    length=starting_length,
    lvariation=length_change,
    aran=angle_randomness,
    lran=length_randomness)  # -> treelin, treept
# ---------- ghpython_script: Python ----------
import rhinoscriptsyntax as rs
import Rhino.Geometry as rg

from math import cos
from math import sin
from math import radians
import random


x1 = 0
y1 = 0
z1 = 0
x2 = x1
y2 = y1
z2 = 0

anglerec = 0 
treelin = []

def fractal(depth , x2, y2, z2, length, anglerec, angle, lvariation, aran, lran):
    
    if depth:
        
        arn = random.uniform(-angle/100*aran, angle/100*aran)
        lrn = random.uniform(-length/100*lran, length/100*lran)
        x1 = x2
        y1 = y2
        z1 = z2
        x2 = x1 + (length+lrn)*cos(radians(anglerec))
        y2 = y1 + (length+lrn)*sin(radians(anglerec))
        length = length*lvariation
        
        stpoint = [x1, y1, z1]
        endpoint = [x2, y2, z2]
        
        treelin.append(rs.AddLine(stpoint, endpoint))
        fractal(depth - 1 , x2, y2, z2, length, (anglerec+angle+arn), angle, lvariation, aran, lran)
        fractal(depth - 1 , x2, y2, z2, length, (anglerec-angle+arn), angle, lvariation, aran, lran)
        
fractal(depth, x2, y2, z2, length, anglerec, angle, lvariation, aran, lran)
# ---------- end ghpython_script ----------
rotate_axis = RotateAxis(Geometry=ghpython_script.treelin, Angle=degrees(Slider(-90, range=-90..100)), Axis=line_sdl)  # -> Geometry, Transform
